# Grasshopper definition hordjessicaassign2.gh (Grasshopper 1.0.7)

# Enter the depth of the slot above.
# 1/8 of the width of the shape is recommended.
depth_of_slot_mm = Slider(9.525, range=0..10)
# Slots
# Enter the thickness of the cardboard here.
# Subtract .5 to make the slots fit together tightly.
# (Example: 4mm would be 3.5 mm)
width_of_cardboard_mm_minus_5 = Slider(3.5, range=0..10)
# Main Shape
radius_of_shape_in_mm = Slider(38.1, range=1..50)
of_sides = Slider(10, range=4..20)
number = Number(-2)
polygon = Polygon(Plane=PlaneXY(0, 0, 0), Radius=radius_of_shape_in_mm, Segments=of_sides, FilletRadius=0)  # -> Polygon, Length
rectangle = Rectangle(Plane=PlaneXY(0, 0, 0), XSize=width_of_cardboard_mm_minus_5, YSize=depth_of_slot_mm, Radius=0)  # -> Rectangle, Length
subtraction = Subtraction(A=radius_of_shape_in_mm, B=depth_of_slot_mm)
division = Division(A=width_of_cardboard_mm_minus_5, B=number)
vector_xyz = VectorXYZ(XComponent=division, YComponent=subtraction, ZComponent=0)  # -> Vector, Length
# Change the number of slots here.
of_slots = Slider(10, range=0..20)
move = Move(Geometry=rectangle.Rectangle, Motion=vector_xyz.Vector)  # -> Geometry, Transform
polar_array = PolarArray(Geometry=move.Geometry, Plane=PlaneXY(0, 0, 0), Count=of_slots, Angle=6.283185307)  # -> Geometry, Transform
region_difference = RegionDifference(CurvesA=polygon.Polygon, CurvesB=polar_array.Geometry)
# After sizes have been adjusted, bake here.
join_curves = JoinCurves(Curves=region_difference, Preserve=False)
