# Grasshopper definition slats.gh (Grasshopper 1.0.7)

hole_radius_inches = Slider(0.42, range=0..100)
thickness_inches = Slider(0.25, range=0..100)
x_length_inches = Slider(2.944, range=0..100)
y_length_inches = Slider(1.616, range=0..100)
number_slider = Slider(2, range=0..100)
circle = Circle(Plane=PlaneXY(0, 0, 0), Radius=hole_radius_inches)
rectangle = Rectangle(Plane=PlaneXY(0, 0, 0), XSize=x_length_inches, YSize=y_length_inches, Radius=0)  # -> Rectangle, Length
division = Division(A=y_length_inches, B=number_slider)
division_2 = Division(A=x_length_inches, B=number_slider)
vector_xyz = VectorXYZ(XComponent=division_2, YComponent=division, ZComponent=0)  # -> Vector, Length
unit_z = UnitZ(Factor=thickness_inches)
move = Move(Geometry=circle, Motion=vector_xyz.Vector)  # -> Geometry, Transform
surface = Surface(rectangle.Rectangle)
surface_2 = Surface(move.Geometry)
extrude = Extrude(Base=surface, Direction=unit_z)
extrude_2 = Extrude(Base=surface_2, Direction=unit_z)
solid_difference = SolidDifference(BrepsA=extrude, BrepsB=extrude_2)
